test file "FSM_test_fixed"

suite "DEAD"
  description: This suite contains all the test performed with DEAD as main state. It includes also the transitions from dead to other states.

  case "Dead-Dead" [baseline]
    description: State under test: DEAD (0)
      Transition under test: DEAD-DEAD
      INPUTS:
      - AccPedal: uniformely increasing request
      - BrakePedal: 0
      - SOC: 0%
      - fuelLevel: 0 lt
      - SOC: 50%
      EXPECTED OUTPUT:
      The state should be DEAD for all the testing time.
    model FSM_Model
    input "Dead1.mat", mapped to realSpeed, Fuel, SOC, AccPedal, BrakePedal (active)
    baseline "Dead_Dead_baseline.mat": leading tol 0.21, lagging tol 0.21
      state:1

  case "Dead-Regen" [baseline]
    description: State under test: DEAD (0)
      Transition under test: DEAD (0) - REGENERATIVE_BRAKING (4)
      INPUT conditions:
      - BrakePedal: != 0 at t = 5s
      - Fuel < fuelMin
      - SOC< SOCMin
      EXPECTED OUTPUT:
      The state should change to REGENERATIVE_BRAKING (4).
    model FSM_Model
    input "Dead2.mat", mapped to realSpeed, Fuel, SOC, AccPedal, BrakePedal (active)
    baseline "Dead_Regen_baseline.mat": leading tol 0.21, lagging tol 0.21
      state:1

  case "Dead-ED" [baseline]
    description: State under test: DEAD (0)
      Transition under test: DEAD (0) - ELECTRIC_DRIVE (ED, 2)
      INPUT conditions:
      - AccPedal < maxAccMGU
      - SOC> SOCMin
      - fuelLevel: 10 lt
      - BrakePedal: 0
      EXPECTED OUTPUT:
      The state should change to ELECTRIC_DRIVE (ED, 2).
    model FSM_Model
    input "Dead3.mat", mapped to realSpeed, Fuel, SOC, AccPedal, BrakePedal (active)
    baseline "Dead_ED_baseline.mat": leading tol 0.21, lagging tol 0.21
      state:1

  case "Dead-NoCharge" [baseline]
    description: State under test: DEAD (0)
      Transition under test: DEAD (0) - NO_CHARGE (1)
      INPUT conditions:
      - AccPedal < maxAccICE
      - SOC < SOCMin
      - Fuel > fuelMin
      - BrakePedal: 0
      EXPECTED OUTPUT:
      The state should change to NO_CHARGE (1).
    model FSM_Model
    input "Dead4.mat", mapped to realSpeed, Fuel, SOC, AccPedal, BrakePedal (active)
    baseline "Dead_NoCharge_baseline.mat": leading tol 0.21, lagging tol 0.21
      state:1

  case "Dead-Combined" [baseline]
    description: State under test: DEAD (0)
      Transition under test: DEAD (0) - COMBINED(3)
      INPUT conditions:
      - AccPedal>maxAccMGU
      - SOC > SOCMin
      - fuel > fuelMin
      - BrakePedal: 0
      EXPECTED OUTPUT:
      The state should change to COMBINED (3).
    model FSM_Model
    input "Dead5.mat", mapped to realSpeed, Fuel, SOC, AccPedal, BrakePedal (active)
    baseline "Dead_Combined_baseline.mat": leading tol 0.21, lagging tol 0.21
      state:1

suite "No Charge"
  description: From No Charge to all other states. Initially, the FSM starts from DEAD, but soon enters the No Charge state at the first sampling instant.

  case "NoCharge-DEAD" [baseline]
    description: State under test: NO_CHARGE (1)
      Transition under test: NO_CHARGE (1) - DEAD (0)
      INPUT conditions:
      - fuel > fuelMin
      - BrakePedal: 0
      EXPECTED OUTPUT:
      The state should change to DEAD (0).
    model FSM_Model
    input "NoCharge1.mat", mapped to realSpeed, Fuel, SOC, AccPedal, BrakePedal (active)
    baseline "NoChargeToDEAD_baseline.mat": leading tol 0.21, lagging tol 0.21
      state:1

  case "NoCharge-Regen" [baseline]
    description: State under test: NO_CHARGE (1)
      Transition under test: NO_CHARGE (1) - REGENERATIVE_BRAKING (4)
      INPUT conditions:
      - Fuel > fuelMin
      - BrakePedal: 0
      EXPECTED OUTPUT:
      The state should change to REGENERATIVE_BRAKING (4).
    model FSM_Model
    input "NoCharge2.mat", mapped to realSpeed, Fuel, SOC, AccPedal, BrakePedal (active)
    baseline "NoChargeToRegen_baseline.mat": leading tol 0.21, lagging tol 0.21
      state:1

  case "NoCharge-ED" [baseline]
    description: State under test: NO_CHARGE (1)
      Transition under test: NO_CHARGE (1) - ELECTRIC_DRIVE (ED, 2)
      INPUT conditions:
      - Fuel > fuelMin
      - BrakePedal: 0
      - SOC < SOCmin for a while, then SOC>SOCmin
      - RealSpeed<SpeedEDMax OR Fuel<fuelMin after a while
      EXPECTED OUTPUT:
      The state should change to ELECTRIC_DRIVE (ED, 2).
      NOTE:
      This test is done in two iterations due to the presence of an OR among input conditions.
    model FSM_Model
    input "NoCharge3.mat", mapped to realSpeed, Fuel, SOC, AccPedal, BrakePedal (active)
    input "NoCharge4.mat", mapped to realSpeed, Fuel, SOC, AccPedal, BrakePedal
    baseline "NoCharge_ED_baseline_Iteration1.mat": leading tol 0.21, lagging tol 0.21
      state:1
    baseline "NoCharge_ED_baseline_Iteration2.mat": leading tol 0.21, lagging tol 0.21
      state:1
    iterations:
      Iteration1: ExternalInput "NoCharge3.mat", Baseline "NoCharge_ED_baseline_Iteration1.mat"
      Iteration2: ExternalInput "NoCharge4.mat", Baseline "NoCharge_ED_baseline_Iteration2.mat"

  case "NoCharge-Combined" [baseline]
    description: State under test: NO_CHARGE (1)
      Transition under test: NO_CHARGE (1) - COMBINED (3)
      INPUT conditions:
      - BrakePedal: 0
      - AccPedal> MaxAccICE
      - Fuel > fuelMin
      - SOC > SOCmin
      EXPECTED OUTPUT:
      The state should change to COMBINED (3).
    model FSM_Model
    input "NoCharge5.mat", mapped to realSpeed, Fuel, SOC, AccPedal, BrakePedal (active)
    baseline "NoChargeToCombined_baseline.mat": leading tol 0.21, lagging tol 0.21
      state:1

  case "NoCharge-NoCharge" [baseline]
    description: State under test: NO_CHARGE (1)
      Transition under test: NO_CHARGE (1) - NO_CHARGE (1)
      INPUT conditions:
      - BrakePedal: 0
      - AccPedal: uniformly increasing
      - Fuel > fuelMin
      - SOC < SOCmin
      EXPECTED OUTPUT:
      The state should remain to NO_CHARGE (1).
    model FSM_Model
    input "NoCharge6.mat", mapped to realSpeed, Fuel, SOC, AccPedal, BrakePedal (active)
    baseline "NoCharge_NoCharge_baseline.mat": leading tol 0.21, lagging tol 0.21
      state:1

suite "ED"
  description: From Electrical Drive to all other states. Initially, the FSM starts from DEAD, but soon enters the ED state at the first sampling instant.

  case "ED-ED" [baseline]
    description: State under test: ELECTRIC_DRIVE (ED, 2)
      Transition under test: ELECTRIC_DRIVE (ED, 2) - ELECTRIC_DRIVE (ED, 2)
      INPUT conditions:
      - RealSpeed < SpeedEDMax
      - AccPedal < MaxAccMGU
      - Fuel > fuelMin
      - SOC > SOCmin
      EXPECTED OUTPUT:
      The state should remain to ELECTRIC_DRIVE (ED, 2).
    model FSM_Model
    input "ED1.mat", mapped to realSpeed, Fuel, SOC, AccPedal, BrakePedal (active)
    baseline "ED_ED_baseline.mat": leading tol 0.21, lagging tol 0.21
      state:1

  case "ED-Regen" [baseline]
    description: State under test: ELECTRIC_DRIVE (ED, 2)
      Transition under test: ELECTRIC_DRIVE (ED, 2) - REGENERATIVE_BRAKING (4)
      INPUT conditions:
      - RealSpeed < SpeedEDMax
      - AccPedal < MaxAccMGU
      - Fuel > fuelMin
      - SOC > SOCmin
      - BrakePedal: !=0 after 5s
      EXPECTED OUTPUT:
      The state should change to REGENERATIVE_BRAKING (4).
    model FSM_Model
    input "ED2.mat", mapped to realSpeed, Fuel, SOC, AccPedal, BrakePedal (active)
    baseline "ED_Regen_baseline.mat": leading tol 0.21, lagging tol 0.21
      state:1

  case "ED-DEAD" [baseline]
    description: State under test: ELECTRIC_DRIVE (ED, 2)
      Transition under test: ELECTRIC_DRIVE (ED, 2) - DEAD (0)
      INPUT conditions:
      - AccPedal: uniformely increasing request
      - Fuel < fuelMin
      - SOC < SOCmin
      - BrakePedal: 0
      EXPECTED OUTPUT:
      The state should change to DEAD (0).
    model FSM_Model
    input "ED3.mat", mapped to realSpeed, Fuel, SOC, AccPedal, BrakePedal (active)
    baseline "ED_Dead_baseline.mat": leading tol 0.21, lagging tol 0.21
      state:1

  case "ED-NoCharge" [baseline]
    description: State under test: ELECTRIC_DRIVE (ED, 2)
      Transition under test: ELECTRIC_DRIVE (ED, 2) - NO_CHARGE (4)
      INPUT conditions:
      - AccPedal < maxAccICE
      - Fuel > fuelMin
      - SOC < SOCmin
      - BrakePedal: 0
      EXPECTED OUTPUT:
      The state should change to NO_CHARGE (1).
    model FSM_Model
    input "ED4.mat", mapped to realSpeed, Fuel, SOC, AccPedal, BrakePedal (active)
    baseline "ED_NoCharge_baseline.mat": leading tol 0.21, lagging tol 0.21
      state:1

  case "ED-Combined" [baseline]
    description: State under test: ELECTRIC_DRIVE (ED, 2)
      Transition under test: ELECTRIC_DRIVE (ED, 2) - COMBINED (3)
      INPUT conditions:
      - AccPedal > MaxAccMGU OR RealSpeed > MaxSpeedMGU
      - Fuel > fuelMin
      - BrakePedal: 0
      - SOC > SOCmin
      EXPECTED OUTPUT:
      The state should change to COMBINED (3).
      NOTE:
      This test is done in two iterations due to the presence of an OR among input conditions.
    model FSM_Model
    input "ED5.mat", mapped to realSpeed, Fuel, SOC, AccPedal, BrakePedal (active)
    input "ED6.mat", mapped to realSpeed, Fuel, SOC, AccPedal, BrakePedal
    baseline "ED_Comb_baseline1.mat": leading tol 0.21, lagging tol 0.21
      state:1
    baseline "ED_Comb_baseline2.mat": leading tol 0.21, lagging tol 0.21
      state:1
    iterations:
      Iteration1: ExternalInput "ED5.mat", Baseline "ED_Comb_baseline1.mat"
      Iteration2: ExternalInput "ED6.mat", Baseline "ED_Comb_baseline2.mat"

suite "Combined"
  description: From Combined to all other states. Initially, the FSM starts from DEAD, but soon enters the Combined state at the first sampling instant.

  case "Combined-Combined" [baseline]
    description: State under test: COMBINED (3)
      Transition under test: COMBINED (3) - COMBINED (3)
      INPUT conditions:
      - RealSpeed>SpeedEDMax
      - Fuel > fuelMin
      - BrakePedal: 0
      - SOC > SOCmin
      EXPECTED OUTPUT:
      The state should remain to COMBINED (3).
    model FSM_Model
    input "Comb1.mat", mapped to realSpeed, Fuel, SOC, AccPedal, BrakePedal (active)
    baseline "Comb_Comb_baseline.mat": leading tol 0.21, lagging tol 0.21
      state:1

  case "Combined-Regen" [baseline]
    description: State under test: COMBINED (3)
      Transition under test: COMBINED (3) - REGENERATIVE_BRAKING(4)
      INPUT conditions:
      - RealSpeed > SpeedMaxED
      - Fuel > fuelMin
      - BrakePedal: != 0 after t = 5s
      - SOC > SOCmin
      EXPECTED OUTPUT:
      The state should change to REGENERATIVE_BRAKING (4).
    model FSM_Model
    input "Comb2.mat", mapped to realSpeed, Fuel, SOC, AccPedal, BrakePedal (active)
    baseline "Comb_Regen_baseline.mat": leading tol 0.21, lagging tol 0.21
      state:1

  case "Combined-DEAD" [baseline]
    description: State under test: COMBINED (3)
      Transition under test: COMBINED (3) - DEAD (0)
      INPUT conditions:
      - Fuel < fuelMin
      - SOC < SOCmin
      EXPECTED OUTPUT:
      The state should change to DEAD (0).
    model FSM_Model
    input "Comb3.mat", mapped to realSpeed, Fuel, SOC, AccPedal, BrakePedal (active)
    baseline "Comb_Dead_baseline.mat": leading tol 0.21, lagging tol 0.21
      state:1

  case "Combined-ED" [baseline]
    description: State under test: COMBINED (3)
      Transition under test: COMBINED (3) - ELECTRIC_DRIVE (ED, 2)
      INPUT conditions:
      - RealSpeed < SpeedEDMax at t = 5s
      - AccPedal < MaxAccMGU after t = 5s
      - BrakePedal: 0
      - SOC > SOCmin
      EXPECTED OUTPUT:
      The state should change to ELECTRIC_DRIVE (ED, 2).
    model FSM_Model
    input "Comb4.mat", mapped to realSpeed, Fuel, SOC, AccPedal, BrakePedal (active)
    baseline "Comb_ED_baseline.mat": leading tol 0.21, lagging tol 0.21
      state:1

  case "Combined-NoCharge" [baseline]
    description: Combined to No Charge state transition check:
      -SOC < SOCMin
      -fuel > fuelMin
      -AccPedal < maxAccICE
      The state should pass from Combined to No Charge
      State under test: COMBINED (3)
      Transition under test: COMBINED (3) - NO_CHARGE (1)
      INPUT conditions:
      - AccPedal < maxAccICE
      - BrakePedal: 0
      - Fuel > fuelMin
      - SOC < SOCmin
      EXPECTED OUTPUT:
      The state should change to NO_CHARGE (1).
    model FSM_Model
    input "Comb5.mat", mapped to realSpeed, Fuel, SOC, AccPedal, BrakePedal (active)
    baseline "Comb_NoCharge_baseline.mat": leading tol 0.21, lagging tol 0.21
      state:1

suite "Regen"
  description: From Regenerative Braking to all other states. Initially, the FSM starts from DEAD, but soon enters the Regen state at the first sampling instant.

  case "Regen-Regen" [baseline]
    description: State under test: REGENERATIVE_BRAKING (4)
      Transition under test: REGENERATIVE_BRAKING (4) - REGENERATIVE_BRAKING (4)
      INPUT conditions:
      - BrakePedal > 0
      EXPECTED OUTPUT:
      The state should remain to REGENERATIVE_BRAKING (4).
    model FSM_Model
    input "Regen1.mat", mapped to realSpeed, Fuel, SOC, AccPedal, BrakePedal (active)
    baseline "Regen_Regen_baseline.mat": leading tol 0.21, lagging tol 0.21
      state:1

  case "Regen-DEAD" [baseline]
    description: State under test: REGENERATIVE_BRAKING (4)
      Transition under test: REGENERATIVE_BRAKING (4) - DEAD (0)
      INPUT conditions:
      - AccPedal > 0 at t = 5 s
      - BrakePedal: 0 at t = 5 s
      - Fuel < fuelMin
      - SOC < SOCmin
      EXPECTED OUTPUT:
      The state should change to DEAD (0).
    model FSM_Model
    input "Regen2.mat", mapped to realSpeed, Fuel, SOC, AccPedal, BrakePedal (active)
    baseline "Regen_Dead_baseline.mat": leading tol 0.21, lagging tol 0.21
      state:1

  case "Regen-ED" [baseline]
    description: State under test: REGENERATIVE_BRAKING (4)
      Transition under test: REGENERATIVE_BRAKING (4) - ELECTRIC_DRIVE (ED, 2)
      INPUT conditions:
      - RealSpeed < SpeedEDMax
      - AccPedal: !=0 at t = 5 s
      - BrakePedal: 0 at t = 5 s
      - SOC < SOCmin for a while, then SOC>SOCmin
      EXPECTED OUTPUT:
      The state should change to ELECTRIC_DRIVE (ED, 2).
    model FSM_Model
    input "Regen3.mat", mapped to realSpeed, Fuel, SOC, AccPedal, BrakePedal (active)
    baseline "Regen_ED_baseline.mat": leading tol 0.21, lagging tol 0.21
      state:1

  case "Regen-NoCharge" [baseline]
    description: State under test: REGENERATIVE_BRAKING (4)
      Transition under test: REGENERATIVE_BRAKING (4) - NO_CHARGE (1)
      INPUT conditions:
      - AccPedal: !=0 at t = 5 s
      - BrakePedal: 0 at t = 5 s
      - Fuel > fuelMin
      - SOC < SOCmin
      EXPECTED OUTPUT:
      The state should change to NO_CHARGE (1).
    model FSM_Model
    input "Regen4.mat", mapped to realSpeed, Fuel, SOC, AccPedal, BrakePedal (active)
    baseline "Regen_NoCharge_baseline.mat": leading tol 0.21, lagging tol 0.21
      state:1

  case "Regen-Combined" [baseline]
    description: State under test: REGENERATIVE_BRAKING (4)
      Transition under test: REGENERATIVE_BRAKING (4) - COMBINED (3)
      INPUT conditions:
      - RealSpeed > SpeedMaxMGU
      - AccPedal: !=0 at t = 5 s
      - BrakePedal: 0 at t = 5 s
      - Fuel > fuelMin
      - SOC > SOCmin
      EXPECTED OUTPUT:
      The state should change to COMBINED (3).
    model FSM_Model
    input "Regen5.mat", mapped to realSpeed, Fuel, SOC, AccPedal, BrakePedal (active)
    baseline "Regen_Combined_baseline.mat": leading tol 0.21, lagging tol 0.21
      state:1